# Dynamo graph basic_example.dyn (Dynamo 1.3.0.875)

number = DoubleInput(0)
byCoordinates = Point.ByCoordinates(x=number, y=number, z=number)
python_script = Python()  # unwired: IN[0]; starter script, not edited (OUT = 0)
number_2 = DoubleInput(0)
number_3 = DoubleInput(0)
python_script_2 = Python(IN[0]=number_3, IN[1]=number_3, IN[2]=number_3)
# ---------- python_script_2.python (13 lines) ----------
import clr
clr.AddReference('ProtoGeometry')
from Autodesk.DesignScript.Geometry import *
#The inputs to this node will be stored as a list in the IN variables.
dataEnteringNode = IN

x = IN[0]
y = IN[1]
z = IN[2]

p = Point.ByCoordinates(x,y,z)
#Assign your output to the OUT variable.
OUT = p
# ----------------------------------------
