# Dynamo graph csv_example.dyn (Dynamo 1.3.0.875)

read_csv_knopen = Python()
# ---------- read_csv_knopen.python (18 lines) ----------
import clr
clr.AddReference('ProtoGeometry')
from Autodesk.DesignScript.Geometry import *
#The inputs to this node will be stored as a list in the IN variables.
dataEnteringNode = IN

knopen_path = r'C:\Users\onno__000\Documents\04_mamba\02_google_drive\Python Cursus\cursussen\03_Nobleo_4dagen_jan_2018\voorbeelden\dynamo\knopen.csv'

with open(knopen_path, 'r') as fo:
	lines = fo.readlines()

knoop_dic = {}
knoop_list = []
for line in lines[1:]:
	k,x,y,z = line.split(',')
	knoop_list.append([k,float(x),float(y),float(z)])

OUT = knoop_list
# ----------------------------------------
watch_knopen_lijst = Watch(read_csv_knopen)
startknoop_nummer = DoubleInput(1)
start_knoop = Python(IN[0]=startknoop_nummer, IN[1]=read_csv_knopen)
# ---------- start_knoop.python (14 lines) ----------
import clr
clr.AddReference('ProtoGeometry')
from Autodesk.DesignScript.Geometry import *
#The inputs to this node will be stored as a list in the IN variables.
dataEnteringNode = IN

nummer = IN[0]
knopen_lijst = IN[1]
knoop_line = knopen_lijst[nummer-1]

p = Point.ByCoordinates(knoop_line[1], knoop_line[2], knoop_line[3])

#Assign your output to the OUT variable.
OUT = p
# ----------------------------------------
eindknoop_nummer = DoubleInput(4)
eind_knoop = Python(IN[0]=eindknoop_nummer, IN[1]=read_csv_knopen)
# ---------- eind_knoop.python (12 lines) ----------
import clr
clr.AddReference('ProtoGeometry')
from Autodesk.DesignScript.Geometry import *
#The inputs to this node will be stored as a list in the IN variables.
dataEnteringNode = IN

knoop_line = IN[1][IN[0]-1]

p = Point.ByCoordinates(knoop_line[1], knoop_line[2], knoop_line[3])

#Assign your output to the OUT variable.
OUT = p
# ----------------------------------------
byStartPointEndPoint = Line.ByStartPointEndPoint(startPoint=start_knoop, endPoint=eind_knoop)
create_lines_from_csv_s = Python()
# ---------- create_lines_from_csv_s.python (35 lines) ----------
import clr
clr.AddReference('ProtoGeometry')
from Autodesk.DesignScript.Geometry import *
#The inputs to this node will be stored as a list in the IN variables.
dataEnteringNode = IN

knopen_path = r'C:\Users\onno__000\Documents\04_mamba\02_google_drive\Python Cursus\cursussen\03_Nobleo_4dagen_jan_2018\voorbeelden\dynamo\knopen.csv'

staven_path = r'C:\Users\onno__000\Documents\04_mamba\02_google_drive\Python Cursus\cursussen\03_Nobleo_4dagen_jan_2018\voorbeelden\dynamo\staven.csv'

with open(knopen_path, 'r') as fo:
	lines = fo.readlines()

knoop_list = []
#TEST
# dictionaries can only be used within a python script you can not use them as output
knoop_dic = {}
for i, line in enumerate(lines[1:]):
	k,x,y,z = line.strip().split(',')
	kp = Point.ByCoordinates(float(x),float(y),float(z))
	knoop_list.append([k,kp])
	knoop_dic[k] = kp
	
	
with open(staven_path, 'r') as fo:
	lines = fo.readlines()

line_list = []
for i, line in enumerate(lines[1:]):
	s, ks, ke, h, b, Bet = line.strip().split(',')
	start_point, end_point = knoop_dic[ks], knoop_dic[ke]
	
	line_list.append(Line.ByStartPointEndPoint(start_point, end_point))

OUT = line_list
# ----------------------------------------
watch_knoop_coordinaat_lijst = Watch(create_lines_from_csv_s)
distanceTo = Geometry.DistanceTo(geometry=start_knoop, other=eind_knoop)
get_origin_of_beam = Python(IN[0]=start_knoop, IN[1]=distanceTo)
# ---------- get_origin_of_beam.python (11 lines) ----------
import clr
clr.AddReference('ProtoGeometry')
from Autodesk.DesignScript.Geometry import *
#The inputs to this node will be stored as a list in the IN variables.

start_point = IN[0]
length = IN[1]

origin_point = Point.ByCoordinates(start_point.X, start_point.Y+0.5 * length, start_point.Z)

OUT = origin_point
# ----------------------------------------
read_csv_staven = Python()
# ---------- read_csv_staven.python (18 lines) ----------
import clr
clr.AddReference('ProtoGeometry')
from Autodesk.DesignScript.Geometry import *
#The inputs to this node will be stored as a list in the IN variables.
dataEnteringNode = IN

staven_path = r'C:\Users\onno__000\Documents\04_mamba\02_google_drive\Python Cursus\cursussen\03_Nobleo_4dagen_jan_2018\voorbeelden\dynamo\staven.csv'

with open(staven_path, 'r') as fo:
	lines = fo.readlines()

line_list = []
for i, line in enumerate(lines[1:]):
	s, ks, ke, h, b, Bet = line.strip().split(',')
	
	line_list.append([s, ks, ke, h, b, Bet])

OUT = line_list
# ----------------------------------------
watch_knoop_coordinaat_lijst_2 = Watch(read_csv_staven)
get_width = Python(IN[0]=watch_knoop_coordinaat_lijst_2)
# ---------- get_width.python (14 lines) ----------
import clr
clr.AddReference('ProtoGeometry')
from Autodesk.DesignScript.Geometry import *
#The inputs to this node will be stored as a list in the IN variables.


staaf1 = IN[0][0]
width = float(staaf1[4])/1000




#Assign your output to the OUT variable.
OUT = width
# ----------------------------------------
get_height = Python(IN[0]=watch_knoop_coordinaat_lijst_2)
# ---------- get_height.python (14 lines) ----------
import clr
clr.AddReference('ProtoGeometry')
from Autodesk.DesignScript.Geometry import *
#The inputs to this node will be stored as a list in the IN variables.


staaf1 = IN[0][0]
width = float(staaf1[3])/1000




#Assign your output to the OUT variable.
OUT = width
# ----------------------------------------
byLengths = Cuboid.ByLengths(origin=get_origin_of_beam, width=get_width, length=distanceTo, height=get_height)
